# Dynamo graph Pavement_Modelling Multilayer.dyn (Dynamo 2.3.0.5885)
# packages: Clockwork for Dynamo 0.9.x 0.90.8

reverse_line = BoolSelector(false)
# note: Inner 선형
select_model_elements = DSModelElementsSelection()  # 9 picked in the model
curves = Element.Curves(element=select_model_elements)
flatten = List.Flatten(list=curves)
byJoinedCurves = PolyCurve.ByJoinedCurves(curves=flatten)
reverse = Curve.Reverse(curve=byJoinedCurves)
if_ = If(test=reverse_line, true=reverse, false=byJoinedCurves)
# note: Chainage 선형
# note: Edges.z data
# note: DongYoung Lim
# dylim@tssni.com
# 16 May 2020 - Fisrt Released
# 19 May 2020 - Solved Vector placement issue
# 21 May 2020 - Dynamo geometry based set angle method applied
# 22 May 2020 - Chaninage Line reverse method added
file_path = Filename("\\192.168.0.238\ENG1_Project\PROJECT\2020 Project\05. N113 & N115\2. 작업\1. Model\4. Dynamo\Road\N115\0521_N115 Branch RoadDynamo(MC05제외)\NB N115 MCG 2 Elevation.xlsx")
file_from_path = FileObject(path=file_path)
string = StringInput("Sheet1")
importExcel = Data.ImportExcel(file=file_from_path, sheetName=string)
code_block = CodeBlock(a=importExcel)
# ---------- code_block.designscript (6 lines) ----------
a[0];
 //Inner;
a[1];
 //Outer;
a[2];
//chaninage
# ----------------------------------------
restOfItems = List.RestOfItems(list=code_block.out2)
code_block_2 = CodeBlock(a=restOfItems) { a*1000; }
dropLastItem = Custom[List.DropLastItem](list=code_block_2)  # package Clockwork for Dynamo 0.9.x; Drops the last item from a given list.
length = Curve.Length(curve=if_)
join = List.Join(list0=dropLastItem, list1=length)
pointAtSegmentLength = Curve.PointAtSegmentLength(curve=if_, segmentLength=join, lacing=Longest)
restOfItems_2 = List.RestOfItems(list=code_block.out1)
code_block_3 = CodeBlock(PTX=pointAtSegmentLength, NewZ=restOfItems_2) { Point.ByCoordinates(PTX.X, PTX.Y, NewZ); }
byPoints = NurbsCurve.ByPoints(points=code_block_3)
# note: Detail level
code_block_4 = CodeBlock { 1000; }
pointsAtEqualSegmentLength = Curve.PointsAtEqualSegmentLength(curve=byPoints, divisions=code_block_4)
select_model_elements_2 = DSModelElementsSelection()  # 167 picked in the model
curves_2 = Element.Curves(element=select_model_elements_2)
flatten_2 = List.Flatten(list=curves_2)
byJoinedCurves_2 = PolyCurve.ByJoinedCurves(curves=flatten_2)
ZAxis = Vector.ZAxis()
restOfItems_3 = List.RestOfItems(list=code_block.out0)
maximumItem = List.MaximumItem(list=restOfItems_3)
code_block_5 = CodeBlock(a=maximumItem) { a+35000; }
extrude = Curve.Extrude(curve=byJoinedCurves_2, direction=ZAxis, distance=code_block_5)
# note: 도로 단면
nb = BoolSelector(true)
code_block_6 = CodeBlock(PTX=pointAtSegmentLength, NewZ=restOfItems_3) { Point.ByCoordinates(PTX.X, PTX.Y, NewZ); }
byPoints_2 = NurbsCurve.ByPoints(points=code_block_6)
pointsAtEqualSegmentLength_2 = Curve.PointsAtEqualSegmentLength(curve=byPoints_2, divisions=code_block_4)
parameterAtPoint = Curve.ParameterAtPoint(curve=byPoints_2, point=pointsAtEqualSegmentLength_2)
normalAtParameter = Curve.NormalAtParameter(curve=byPoints_2, param=parameterAtPoint, lacing=Longest)
X = Vector.X(vector=normalAtParameter)
Y = Vector.Y(vector=normalAtParameter)
byCoordinates = Vector.ByCoordinates(x=X, y=Y)
reverse_2 = Vector.Reverse(vector=byCoordinates)
if_2 = If(test=nb, true=reverse_2, false=byCoordinates)
project = Point.Project(point=pointsAtEqualSegmentLength, baseGeometry=extrude, projectionDirection=if_2, lacing=Longest)
# note: Outer 선형
select_model_elements_3 = DSModelElementsSelection()  # 50 picked in the model
curves_3 = Element.Curves(element=select_model_elements_3)
flatten_3 = List.Flatten(list=curves_3)
byJoinedCurves_3 = PolyCurve.ByJoinedCurves(curves=flatten_3)
ZAxis_2 = Vector.ZAxis()
extrude_2 = Curve.Extrude(curve=byJoinedCurves_3, direction=ZAxis_2, distance=code_block_5)
project_2 = Point.Project(point=pointsAtEqualSegmentLength_2, baseGeometry=extrude_2, projectionDirection=if_2, lacing=Longest)
byStartPointEndPoint = Line.ByStartPointEndPoint(startPoint=project, endPoint=project_2)
code_block_7 = CodeBlock { 0.5; }
pointAtParameter = Curve.PointAtParameter(curve=byStartPointEndPoint, param=code_block_7)
tangentAtParameter = Curve.TangentAtParameter(curve=byPoints_2, param=parameterAtPoint)
byOriginNormal = Plane.ByOriginNormal(origin=pointAtParameter, normal=tangentAtParameter, lacing=Longest)
code_block_8 = CodeBlock { 10; }
byPlaneRadius = Circle.ByPlaneRadius(plane=byOriginNormal, radius=code_block_8)
patch = Curve.Patch(curve=byPlaneRadius)
byGeometry = ImportInstance.ByGeometry(geometry=patch)
family_types = FamilyTypes("LTA_ROAD_PAVE_50mm:LTA_ROAD_PAVE_50mm")
faces = Element.Faces(element=byGeometry)
flatten_4 = List.Flatten(list=faces)
flatten_5 = List.Flatten(list=pointAtParameter)
ZAxis_3 = Vector.ZAxis()
byFace = FamilyInstance.ByFace(familyType=family_types, face=flatten_4, location=flatten_5, referenceDirection=ZAxis_3)
code_block_9 = CodeBlock { "LEFT"; }
distanceTo = Geometry.DistanceTo(geometry=pointAtParameter, other=project_2)
code_block_10 = CodeBlock { "RIGHT"; }
distanceTo_2 = Geometry.DistanceTo(geometry=pointAtParameter, other=project)
setParameterByName = Element.SetParameterByName(element=byFace@L2, parameterName=code_block_10, value=distanceTo_2)
code_block_11 = CodeBlock(passthrough=distanceTo, waitfor=setParameterByName) { [passthrough,waitfor][0]; }
setParameterByName_2 = Element.SetParameterByName(element=byFace@L2, parameterName=code_block_9, value=code_block_11)
curves_4 = Element.Curves(element=setParameterByName_2)
firstItem = List.FirstItem(list=curves_4@L2)
restOfItems_4 = List.RestOfItems(list=curves_4@L2)
join_2 = Curve.Join(curve=firstItem, curves=restOfItems_4)
flatten_6 = List.Flatten(list=byOriginNormal)
Z = Point.Z(point=project_2)
Z_2 = Point.Z(point=project)
sub = Z - Z_2
length_2 = Curve.Length(curve=byStartPointEndPoint)
div = sub / length_2
asin = Math.Asin(ratio=div)
code_block_12 = CodeBlock(a=asin) { a; }
code_block_13 = CodeBlock(a=asin) { -a; }
if_3 = If(test=nb, true=code_block_12, false=code_block_13)
code_block_14 = CodeBlock(a=if_3) { 90-a; }
code_block_15 = CodeBlock(a=code_block_14) { a+180; }
flatten_7 = List.Flatten(list=code_block_15)
rotate = Geometry.Rotate(geometry=join_2, basePlane=flatten_6, degrees=flatten_7)
code_block_16 = CodeBlock { 0..1; }
code_block_17 = CodeBlock { 1; }
sublists = List.Sublists(list=rotate, ranges=code_block_16, offset=code_block_17)
byLoft = Solid.ByLoft(crossSections=sublists)
byGeometry_2 = ImportInstance.ByGeometry(geometry=byLoft)
code_block_18 = CodeBlock(passthrough=byGeometry, waitfor=byGeometry_2) { [passthrough,waitfor][0]; }
python_script = Python(IN[0]=code_block_18)
# ---------- python_script.python (17 lines) ----------
import clr
clr.AddReference("RevitServices")
import RevitServices
from RevitServices.Persistence import DocumentManager
from RevitServices.Transactions import TransactionManager

doc = DocumentManager.Instance.CurrentDBDocument
obj=UnwrapElement(IN[0]).Id

TransactionManager.Instance.EnsureInTransaction(doc)
try:
	rtn = doc.Delete(obj)
except:
	rtn = None
TransactionManager.Instance.TransactionTaskDone()

OUT=rtn
# ----------------------------------------
# note: Change 간격
number = DoubleInput(30000)  # frozen
code_block_19 = CodeBlock(a=length, b=number) { 0..a..(b); }
family_types_2 = FamilyTypes("LTA_ROAD_PAVE_50mm:LTA_ROAD_PAVE_50mm")  # frozen
reverse_3 = Vector.Reverse(vector=tangentAtParameter)
flatten_8 = List.Flatten(list=project_2)
abs = Math.Abs(number=sub)
flatten_9 = List.Flatten(list=if_3)
테스트용 = CodeBlock(a=flatten_4, b=flatten_5, c=flatten_9, d=byOriginNormal) { i=[50..100]; a[i]; b[i]; c[i]; d[i]; }  # frozen
code_block_20 = CodeBlock(a=테스트용.out3) { 90+a; }
direction = Line.Direction(line=byStartPointEndPoint)
XAxis = Vector.XAxis()
angleWithVector = Vector.AngleWithVector(vector=direction, otherVector=XAxis, lacing=Longest)
flatten_10 = List.Flatten(list=테스트용.out4)
code_block_21 = CodeBlock(passthrough=byFace, waitfor=byGeometry_2) { [passthrough,waitfor][0]; }
python_script_2 = Python(IN[0]=code_block_21)  # same code as python_script
family_types_3 = FamilyTypes("LTA_ROAD_PAVE_120mm:LTA_ROAD_PAVE_120mm")
byFace_2 = FamilyInstance.ByFace(familyType=family_types_3, face=flatten_4, location=flatten_5, referenceDirection=ZAxis_3)
code_block_22 = CodeBlock { "LEFT"; }
distanceTo_3 = Geometry.DistanceTo(geometry=pointAtParameter, other=project_2)
code_block_23 = CodeBlock { "RIGHT"; }
distanceTo_4 = Geometry.DistanceTo(geometry=pointAtParameter, other=project)
setParameterByName_3 = Element.SetParameterByName(element=byFace_2@L2, parameterName=code_block_23, value=distanceTo_4)
code_block_24 = CodeBlock(passthrough=distanceTo_3, waitfor=setParameterByName_3) { [passthrough,waitfor][0]; }
setParameterByName_4 = Element.SetParameterByName(element=byFace_2@L2, parameterName=code_block_22, value=code_block_24)
curves_5 = Element.Curves(element=setParameterByName_4)
firstItem_2 = List.FirstItem(list=curves_5@L2)
restOfItems_5 = List.RestOfItems(list=curves_5@L2)
join_3 = Curve.Join(curve=firstItem_2, curves=restOfItems_5)
code_block_25 = CodeBlock(a=code_block_14) { a+180; }
flatten_11 = List.Flatten(list=code_block_25)
rotate_2 = Geometry.Rotate(geometry=join_3, basePlane=flatten_6, degrees=flatten_11)
code_block_26 = CodeBlock { 0..1; }
code_block_27 = CodeBlock { 1; }
sublists_2 = List.Sublists(list=rotate_2, ranges=code_block_26, offset=code_block_27)
byLoft_2 = Solid.ByLoft(crossSections=sublists_2)
byGeometry_3 = ImportInstance.ByGeometry(geometry=byLoft_2)
code_block_28 = CodeBlock(passthrough=byFace_2, waitfor=byGeometry_3) { [passthrough,waitfor][0]; }
python_script_3 = Python(IN[0]=code_block_28)  # same code as python_script
code_block_29 = CodeBlock(passthrough=byGeometry, waitfor=byGeometry_3) { [passthrough,waitfor][0]; }
python_script_4 = Python(IN[0]=code_block_29)  # same code as python_script
family_types_4 = FamilyTypes("LTA_ROAD_PAVE_250mm:LTA_ROAD_PAVE_250mm")
byFace_3 = FamilyInstance.ByFace(familyType=family_types_4, face=flatten_4, location=flatten_5, referenceDirection=ZAxis_3)
code_block_30 = CodeBlock { "LEFT"; }
distanceTo_5 = Geometry.DistanceTo(geometry=pointAtParameter, other=project_2)
code_block_31 = CodeBlock { "RIGHT"; }
distanceTo_6 = Geometry.DistanceTo(geometry=pointAtParameter, other=project)
setParameterByName_5 = Element.SetParameterByName(element=byFace_3@L2, parameterName=code_block_31, value=distanceTo_6)
code_block_32 = CodeBlock(passthrough=distanceTo_5, waitfor=setParameterByName_5) { [passthrough,waitfor][0]; }
setParameterByName_6 = Element.SetParameterByName(element=byFace_3@L2, parameterName=code_block_30, value=code_block_32)
curves_6 = Element.Curves(element=setParameterByName_6)
firstItem_3 = List.FirstItem(list=curves_6@L2)
restOfItems_6 = List.RestOfItems(list=curves_6@L2)
join_4 = Curve.Join(curve=firstItem_3, curves=restOfItems_6)
code_block_33 = CodeBlock(a=code_block_14) { a+180; }
flatten_12 = List.Flatten(list=code_block_33)
rotate_3 = Geometry.Rotate(geometry=join_4, basePlane=flatten_6, degrees=flatten_12)
code_block_34 = CodeBlock { 0..1; }
code_block_35 = CodeBlock { 1; }
sublists_3 = List.Sublists(list=rotate_3, ranges=code_block_34, offset=code_block_35)
byLoft_3 = Solid.ByLoft(crossSections=sublists_3)
byGeometry_4 = ImportInstance.ByGeometry(geometry=byLoft_3)
code_block_36 = CodeBlock(passthrough=byGeometry, waitfor=byGeometry_4) { [passthrough,waitfor][0]; }
python_script_5 = Python(IN[0]=code_block_36)  # same code as python_script
code_block_37 = CodeBlock(passthrough=byFace_3, waitfor=byGeometry_4) { [passthrough,waitfor][0]; }
python_script_6 = Python(IN[0]=code_block_37)  # same code as python_script
