# Dynamo graph PlaceUtilityunderTopo.DYN "PlaceUtilityunderTopo.DYN" (Dynamo 2.3.0.5885)
# packages: archi-lab.net 2020.23.11

# group: Existing
pipeType = DoubleInput(1)
pipeSystemType = DoubleInput(11)
pipe_diameter_mm = CodeBlock { 100; }

# group: PipeType
element_types = ElementTypes("PipeType")
all_elements_of_type = ElementsOfType(element_type=element_types)
count = List.Count(list=all_elements_of_type)
code_block = CodeBlock(c=count, d=all_elements_of_type, num=pipeType) { i=0..c-1; d[i]; name = d[i].Name; num; d[num]; }

# group: Pipe System
element_types_2 = ElementTypes("PipingSystemType")
all_elements_of_type_2 = ElementsOfType(element_type=element_types_2)
count_2 = List.Count(list=all_elements_of_type_2)
code_block_2 = CodeBlock(c=count_2, d=all_elements_of_type_2, num=pipeSystemType) { i=0..c-1; d[i]; name = d[i].Name; num; d[num]; }

relay = Relay(code_block_2.name)

# group: Pick number using informaion below
pipe_type = Watch(code_block.name)
pipe_system_type = Watch(relay)

# group: Input
select_phase = RevitPhases("Existing")
topo = DSModelElementSelection()  # 1 picked in the model
offset_depth_mm = DoubleInput(2000)
levels_set_to_0m = Levels("Stage 0E0 - Existing Status")
# note: Existing
select_phase_2 = RevitPhases("Proposed & Remove")
# note: Demolished
# note: Proposed
select_phase_3 = RevitPhases("Proposed & Remove")

# note: How to use
# 1. Set False, disconnect with Step and Run Dynamo
# 2. Set all attributes in red box
# 3. Set True, connect with Step and Run Dynamo
# note: DY Lim
# dylim@tssni.com
# 21 May 2020 - Alpha released
boolean = BoolSelector(false)
step = CodeBlock(a=boolean) { a; }

# group: Existing
phase_created = Python(IN[0]=select_phase)
# ---------- phase_created.python (19 lines) ----------
#Alban de Chasteigner 2020
#twitter : @geniusloci_bim
#geniusloci.bim@gmail.com

import clr
clr.AddReference('RevitAPI')
import Autodesk
from Autodesk.Revit.DB import *

phases = UnwrapElement(IN[0]) if isinstance(IN[0],list) else [UnwrapElement(IN[0])]
phaseList = []

for phase in phases :
	doc=phase.Document
	filter=ElementParameterFilter(ParameterFilterRuleFactory.CreateEqualsRule(ElementId(BuiltInParameter.PHASE_CREATED), phase.Id))
	phaseList.append(FilteredElementCollector(doc).WherePasses(filter).WhereElementIsNotElementType().ToElements())
	
if isinstance(IN[0], list): OUT = phaseList
else: OUT = phaseList[0]
# ----------------------------------------
code_block_3 = CodeBlock { ""; }
if_ = If(test=step, true=phase_created, false=code_block_3)
getLocation = Element.GetLocation(element=if_)
python_script = Python(IN[0]=getLocation)
# ---------- python_script.python (23 lines) ----------
#Copyright(c) 2015, Konrad K Sobon
# @arch_laboratory, http://archi-lab.net

import clr
clr.AddReference('ProtoGeometry')
from Autodesk.DesignScript.Geometry import *
#The inputs to this node will be stored as a list in the IN variable.
dataEnteringNode = IN

def ClearList(_list):
    out = []
    for _list1 in _list:
        if _list1 is None:
            continue
        if isinstance(_list1, list):
             _list1 = ClearList(_list1)
             if not _list1:
                 continue
        out.append(_list1)
    return out

#Assign your output to the OUT variable
OUT = ClearList(IN[0])
# ----------------------------------------
type = Object.Type(obj=python_script)
string = StringInput("Line")
contains = String.Contains(str=type, searchFor=string)
filterByBoolMask = List.FilterByBoolMask(list=python_script, mask=contains)

# group: Topo
mesh = Topography.Mesh(topography=topo)
boolean_2 = BoolSelector(false)
code_block_4 = CodeBlock { 20; }
code_block_5 = CodeBlock(mesh=mesh, mergeall=boolean_2, threads=code_block_4) { mesh; mergeall; threads; }
python_script_2 = Python(IN[0]=code_block_5.mesh, IN[1]=code_block_5.mergeall, IN[2]=code_block_5.threads)
# ---------- python_script_2.python (63 lines) ----------
# Copyright(c) 2019, Dimitar Venkov
# @5devene, dimitar.ven@gmail.com
# www.badmonkeys.net

import clr
from System.Threading import Thread, ThreadStart

clr.AddReference('ProtoGeometry')
from Autodesk.DesignScript.Geometry import PolySurface, Surface

meshes, mergeAll, NUMTHREADS = IN
CHOPLIMIT = 10

def tolist(obj1):
	if hasattr(obj1,'__iter__'): return obj1
	return [obj1]

def chop(l1, n):
	return [l1[x:x+n] for x in xrange(0, len(l1), n)]

def ps_generator(ptslist,
				 f_ps1=PolySurface.ByJoinedSurfaces,
				 f_sf1=Surface.ByPerimeterPoints):
		
		sflist = map(f_sf1, ptslist)
		while len(sflist) > CHOPLIMIT:
			new_sflist = map(f_ps1, chop(sflist, CHOPLIMIT))
			for s in sflist: s.Dispose()
			sflist = new_sflist
		return sflist

def mesh2ps(topo):
	vp = topo.VertexPositions
	ptslist = [[vp[i.A], vp[i.B], vp[i.C]] for i in topo.FaceIndices]
	len1 = len(ptslist) / NUMTHREADS + 1

	if len(ptslist) > NUMTHREADS * 3 and NUMTHREADS > 1:
		ptslist = chop(ptslist, len1)
		
		class Worker(object):
			__slots__ = 'fn', 'args', 'result'
			def __init__(self, fn, args):
				self.fn = fn
				self.args = args
				self.result = None
			def __call__(self):
				self.result = self.fn(*self.args)
		
		workers, tasks = [], []
		for p in ptslist:
			w = Worker(ps_generator, (p,))
			t = Thread(ThreadStart(w))
			workers.append(w)
			tasks.append(t)
			t.Start()

		for t in tasks: t.Join()
		return PolySurface.ByJoinedSurfaces(i for w in workers for i in w.result)
	else:
		return  PolySurface.ByJoinedSurfaces(ps_generator(ptslist))

OUT = map(mesh2ps, tolist(meshes))
if mergeAll: OUT = PolySurface.ByJoinedSurfaces(OUT)
# ----------------------------------------

ZAxis = Vector.ZAxis()
project = Curve.Project(curve=filterByBoolMask.in, baseGeometry=python_script_2, projectionDirection=ZAxis, lacing=Longest)
startPoint = Curve.StartPoint(curve=project)
endPoint = Curve.EndPoint(curve=project)
code_block_6 = CodeBlock(P1=startPoint, Target=offset_depth_mm, P2=endPoint)
# ---------- code_block_6.designscript (3 lines) ----------
st=Point.ByCoordinates(P1.X,P1.Y,P1.Z-Target);
en=Point.ByCoordinates(P2.X,P2.Y,P1.Z-Target);
Line.ByStartPointEndPoint(st,en);
# ----------------------------------------
flatten = List.Flatten(list=code_block_6.out2)
code_block_7 = CodeBlock(Lines=flatten, PipeType=code_block.out4, SystemType=code_block_2.out4, level=levels_set_to_0m, Diameter=pipe_diameter_mm) { Lines; PipeType; SystemType; level; Diameter; }
python_script_3 = Python(IN[0]=code_block_7.Lines, IN[1]=code_block_7.PipeType, IN[2]=code_block_7.SystemType, IN[3]=code_block_7.level, IN[4]=code_block_7.Diameter)
# ---------- python_script_3.python (69 lines) ----------
import clr

clr.AddReference("RevitServices")
import RevitServices
from RevitServices.Persistence import DocumentManager
from RevitServices.Transactions import TransactionManager
doc = DocumentManager.Instance.CurrentDBDocument

clr.AddReference("RevitAPI")
import Autodesk
from Autodesk.Revit.DB import *

clr.AddReference("RevitNodes")
import Revit
clr.ImportExtensions(Revit.Elements)
clr.ImportExtensions(Revit.GeometryConversion)


if isinstance(IN[0], list):
	lines = IN[0]
else:
	lines = [IN[0]]
FirstPoint = [x.StartPoint for x in lines]
SecondPoint = [x.EndPoint for x in lines]
if isinstance(IN[1], list):
	pipetype = UnwrapElement(IN[1])
else:
	pipetype = [UnwrapElement(IN[1])]
ptl = len(pipetype)

if isinstance(IN[2], list):
	systemtype = UnwrapElement(IN[2])
else:
	systemtype = [UnwrapElement(IN[2])]
stl = len(systemtype)
if isinstance(IN[3], list):
	level = UnwrapElement(IN[3])
else:
	level = [UnwrapElement(IN[3])]
ll = len(level)
if isinstance(IN[4], list):
	diameter = IN[4]
else:
	diameter = [IN[4]]
dl = len(diameter)

elements = []

TransactionManager.Instance.EnsureInTransaction(doc)
for i,x in enumerate(FirstPoint):
	try:
		levelid = level[i%ll].Id
		systypeid = systemtype[i%stl].Id
		pipetypeid = pipetype[i%ptl].Id
		diam = diameter[i%dl]
		
		pipe = Autodesk.Revit.DB.Plumbing.Pipe.Create(doc,systypeid,pipetypeid,levelid,x.ToXyz(),SecondPoint[i].ToXyz())
		
		param = pipe.get_Parameter(BuiltInParameter.RBS_PIPE_DIAMETER_PARAM)
		param.SetValueString(diam.ToString())
	
		elements.append(pipe.ToDSType(False))	
	except:
		elements.append(None)

TransactionManager.Instance.TransactionTaskDone()


OUT = elements
# ----------------------------------------
select_phase_4 = RevitPhases("Existing")
code_block_8 = CodeBlock(origin=phase_created, ele=python_script_3, origin_phS=select_phase_4)
# ---------- code_block_8.designscript (9 lines) ----------
origin_co=Element.GetParameterValueByName(origin[0],"Comments");
//get original comment attributes
Element.SetParameterByName(ele,"Comments",origin_co);

Element.SetParameterByName(ele,"Phase Created",origin_phS);

//origin_phE=Element.GetParameterValueByName(origin,"Phase Demolished");
//get original phase Demolished attributes;
//Element.SetParameterByName(ele,"Phase Created",origin_phE);
# ----------------------------------------

# group: Demolished
phase_demolished = Python(IN[0]=select_phase_2)
# ---------- phase_demolished.python (19 lines) ----------
#Alban de Chasteigner 2020
#twitter : @geniusloci_bim
#geniusloci.bim@gmail.com

import clr
clr.AddReference('RevitAPI')
import Autodesk
from Autodesk.Revit.DB import *

phases = UnwrapElement(IN[0]) if isinstance(IN[0],list) else [UnwrapElement(IN[0])]
phaseList = []

for phase in phases :
	doc=phase.Document
	filter=ElementParameterFilter(ParameterFilterRuleFactory.CreateEqualsRule(ElementId(BuiltInParameter.PHASE_DEMOLISHED), phase.Id))
	phaseList.append(FilteredElementCollector(doc).WherePasses(filter).WhereElementIsNotElementType().ToElements())
	
if isinstance(IN[0], list): OUT = phaseList
else: OUT = phaseList[0]
# ----------------------------------------
if_2 = If(test=step, true=phase_demolished, false=code_block_3)
getLocation_2 = Element.GetLocation(element=if_2)
python_script_4 = Python(IN[0]=getLocation_2)  # same code as python_script
type_2 = Object.Type(obj=python_script_4)
string_2 = StringInput("Line")
contains_2 = String.Contains(str=type_2, searchFor=string_2)
filterByBoolMask_2 = List.FilterByBoolMask(list=python_script_4, mask=contains_2)

relay_2 = Relay(phase_demolished)
project_2 = Curve.Project(curve=filterByBoolMask_2.in, baseGeometry=python_script_2, projectionDirection=ZAxis, lacing=Longest)
startPoint_2 = Curve.StartPoint(curve=project_2)
endPoint_2 = Curve.EndPoint(curve=project_2)
code_block_9 = CodeBlock(P1=startPoint_2, Target=offset_depth_mm, P2=endPoint_2)  # same code as code_block_6
flatten_2 = List.Flatten(list=code_block_9.out2)

# group: Demolished
pipeType_2 = DoubleInput(1)
pipeSystemType_2 = DoubleInput(11)
pipe_diameter_mm_2 = CodeBlock { 100; }

# group: PipeType
element_types_3 = ElementTypes("PipeType")
all_elements_of_type_3 = ElementsOfType(element_type=element_types_3)
count_3 = List.Count(list=all_elements_of_type_3)
code_block_10 = CodeBlock(c=count_3, d=all_elements_of_type_3, num=pipeType_2) { i=0..c-1; d[i]; name = d[i].Name; num; d[num]; }

# group: Pipe System
element_types_4 = ElementTypes("PipingSystemType")
all_elements_of_type_4 = ElementsOfType(element_type=element_types_4)
count_4 = List.Count(list=all_elements_of_type_4)
code_block_11 = CodeBlock(c=count_4, d=all_elements_of_type_4, num=pipeSystemType_2) { i=0..c-1; d[i]; name = d[i].Name; num; d[num]; }

code_block_12 = CodeBlock(Lines=flatten_2, PipeType=code_block_10.out4, SystemType=code_block_11.out4, level=levels_set_to_0m, Diameter=pipe_diameter_mm_2) { Lines; PipeType; SystemType; level; Diameter; }
python_script_5 = Python(IN[0]=code_block_12.Lines, IN[1]=code_block_12.PipeType, IN[2]=code_block_12.SystemType, IN[3]=code_block_12.level, IN[4]=code_block_12.Diameter)  # same code as python_script_3
select_phase_5 = RevitPhases("Existing")
select_phase_6 = RevitPhases("Proposed & Remove")
code_block_13 = CodeBlock(origin=relay_2, ele=python_script_5, origin_phS=select_phase_5, origin_phE=select_phase_6)
# ---------- code_block_13.designscript (7 lines) ----------
origin_co=Element.GetParameterValueByName(origin[0],"Comments");
//get original comment attributes
Element.SetParameterByName(ele,"Comments",origin_co);

Element.SetParameterByName(ele,"Phase Created",origin_phS);

Element.SetParameterByName(ele,"Phase Created",origin_phE);
# ----------------------------------------

# group: Permanenet
phase_created_2 = Python(IN[0]=select_phase_3)  # same code as phase_created
if_3 = If(test=step, true=phase_created_2, false=code_block_3)
getLocation_3 = Element.GetLocation(element=if_3)
python_script_6 = Python(IN[0]=getLocation_3)  # same code as python_script
type_3 = Object.Type(obj=python_script_6)
string_3 = StringInput("Line")
contains_3 = String.Contains(str=type_3, searchFor=string_3)
filterByBoolMask_3 = List.FilterByBoolMask(list=python_script_6, mask=contains_3)

project_3 = Curve.Project(curve=filterByBoolMask_3.in, baseGeometry=python_script_2, projectionDirection=ZAxis, lacing=Longest)
startPoint_3 = Curve.StartPoint(curve=project_3)
endPoint_3 = Curve.EndPoint(curve=project_3)
code_block_14 = CodeBlock(P1=startPoint_3, Target=offset_depth_mm, P2=endPoint_3)  # same code as code_block_6
flatten_3 = List.Flatten(list=code_block_14.out2)

# group: Permanent
pipeType_3 = DoubleInput(1)
pipeSystemType_3 = DoubleInput(11)
pipe_diameter_mm_3 = CodeBlock { 100; }

# group: PipeType
element_types_5 = ElementTypes("PipeType")
all_elements_of_type_5 = ElementsOfType(element_type=element_types_5)
count_5 = List.Count(list=all_elements_of_type_5)
code_block_15 = CodeBlock(c=count_5, d=all_elements_of_type_5, num=pipeType_3) { i=0..c-1; d[i]; name = d[i].Name; num; d[num]; }

# group: Pipe System
element_types_6 = ElementTypes("PipingSystemType")
all_elements_of_type_6 = ElementsOfType(element_type=element_types_6)
count_6 = List.Count(list=all_elements_of_type_6)
code_block_16 = CodeBlock(c=count_6, d=all_elements_of_type_6, num=pipeSystemType_3) { i=0..c-1; d[i]; name = d[i].Name; num; d[num]; }

code_block_17 = CodeBlock(Lines=flatten_3, PipeType=code_block_15.out4, SystemType=code_block_16.out4, level=levels_set_to_0m, Diameter=pipe_diameter_mm_3) { Lines; PipeType; SystemType; level; Diameter; }
python_script_7 = Python(IN[0]=code_block_17.Lines, IN[1]=code_block_17.PipeType, IN[2]=code_block_17.SystemType, IN[3]=code_block_17.level, IN[4]=code_block_17.Diameter)  # same code as python_script_3
select_phase_7 = RevitPhases("Proposed & Remove")
code_block_18 = CodeBlock(origin=phase_created_2, ele=python_script_7, origin_phS=select_phase_7)  # same code as code_block_8
